# Dynamo graph Parameters.dyn (Dynamo 3.0.3.7597)

select_model_elements = DSModelElementsSelection()  # 2 picked in the model
python_script = Python(IN[0]=select_model_elements)  # CPython3
# ---------- python_script.python (136 lines) ----------
import clr

import sys
sys.path.append('C:\Program Files (x86)\IronPython 2.7\Lib')

import System
from System.Collections.Generic import *

clr.AddReference('ProtoGeometry')
from Autodesk.DesignScript.Geometry import *

clr.AddReference("RevitNodes")
import Revit
clr.ImportExtensions(Revit.Elements)
clr.ImportExtensions(Revit.GeometryConversion)
clr.AddReference("RevitServices")
import RevitServices
from RevitServices.Persistence import DocumentManager 
from RevitServices.Transactions import TransactionManager 

clr.AddReference("RevitAPI")
clr.AddReference("RevitAPIUI")

import Autodesk 
from Autodesk.Revit.DB import *
from Autodesk.Revit.UI import *

doc = DocumentManager.Instance.CurrentDBDocument
uiapp = DocumentManager.Instance.CurrentUIApplication 
app = uiapp.Application 
uidoc = uiapp.ActiveUIDocument

def tolist(obj1):
	if isinstance(obj1,(list, tuple, set)): return obj1
	else: return [obj1]

#Preparing input from dynamo to revit
#element = UnwrapElement(IN[0])

#Do some action in a Transaction










































"""




TransactionManager.Instance.EnsureInTransaction(doc)

paramList = []

for wall in wallList:
    parameter = wall.LookupParameter("Base Constraint")
    paramValue = parameter.AsElementId() #.AsDouble()*0.092903
    #boolValue = bool(paramValue)
    paramList.append(paramValue)


TransactionManager.Instance.TransactionTaskDone()

level = doc.GetElement(paramList[0])
"""














wallList = tolist(UnwrapElement(IN[0]))

levelElevations = []

for wall in wallList:
    baseParam = wall.LookupParameter("Base Constraint").AsElementId()
    level = doc.GetElement(baseParam)
    levelEle = level.LookupParameter("Elevation").AsDouble()*304.8
    levelElevations.append(levelEle)










OUT = [["Level1", 500], ["Level 2", 1000]]
# ----------------------------------------
select_model_element = DSModelElementSelection()  # 1 picked in the model
code_block = CodeBlock { "Comments"; }
getParameterValueByName = Element.GetParameterValueByName(element=select_model_element, parameterName=code_block)
levels = Levels("Level 0")
